# Grasshopper definition brail.gh (Grasshopper 1.0.8)
# plug-ins: RhinoCodePluginGH

txt = Text("HELLO WORLD")
len = TextLength(Text=txt)
chars = Characters(Text=txt)  # -> Result, Unicode

# ---- group: TRANSLATE TEXT BASED ON TABLE
path = FilePath("C:\Users\PoPoA\Desktop\brail\brailLib.txt")
file = ReadFile(File=path, PerLineParse=True)
join = TextJoin(Text=file)
lng = ListLength(List=file)
py3 = Python3Script(a=join, b=chars.Result, B_len=lng, T_len=len)  # -> out, c1, c2, c3, c4, c5, c6
# ---------- py3: Python ----------
"""Grasshopper Script"""
br=a.split('.')
#print(br[3][0])
#print(br[2][2:])
c1=0
c2=0
c3=0
c4=0
c5=0
c6=0
for i in range(B_len):
    x=br[i][0]
    if b == x:
        j=br[i][2:]
        c1=j[2]
        c2=j[4]
        c3=j[8]
        c4=j[10]
        c5=j[14]
        c6=j[16]
        print(j)
# ---------- end py3 ----------
entwine = Entwine(Branch00=py3.c6, Branch01=py3.c5, Branch02=py3.c4, Branch03=py3.c3, Branch04=py3.c2, Branch05=py3.c1, FlattenInputs=True)
dot_radius = Slider(0.75, range=0..1)
multiplication = Multiplication(A=entwine, B=dot_radius)
flip = FlipMatrix(Data=multiplication)

# ---- group: box
Y = UnitY(Factor=1)
X = UnitX(Factor=1)
pl = ConstructPlane(Origin=Point(0, 0, 0), XAxis=X, YAxis=Y)
box = DomainBox(Base=pl, X=Slider(250, range=0..1000), Y=Slider(250, range=0..1000), Z=Slider(1, range=0..100))

# ---- group: CHAR GEOMETRY
space_between_dots = Slider(2.5, range=0..10)
dot_columbs = Slider(3, range=0..10)
dot_rows = Slider(2, range=0..10)
rectangle = Rectangle(Plane=PlaneXY(0, 0, 0), XSize=space_between_dots, YSize=space_between_dots, Radius=0)  # -> Rectangle, Length
arrrec = RectangularArray(Cell=rectangle.Rectangle, XCount=dot_rows, YCount=dot_columbs)  # -> Geometry, Transform

# ----
arrlinear = LinearArray(Geometry=pl, Direction=Vector(10, 0, 0), Count=len)  # -> Geometry, Transform
sph = Sphere(Base=arrrec.Transform, Radius=flip)
flip_2 = FlipMatrix(Data=arrlinear.Transform)
move = Move(Geometry=sph, Motion=flip_2)  # -> Geometry, Transform
